# Grasshopper definition Simulation of collagen in liver lobules.gh (Grasshopper 1.0.7)
# plug-ins: Kangaroo2 Components

# ---- group: The size of the rectangle get simulated
# README
# - The default size of the rectangle get simualated is 30 and the number to control resolution is 8000 to simulate contraction in one liver lobule.
# - If you want to simulate the contraction in 7 liver lobules, you can change the size of the rectangle get simulated to 70 and the number to control resolution to 40000, but this simulation could take much longer to find results.
panel = Panel("30")

# ----
multiplication = Multiplication(A=panel, B="-1")
dom = ConstructDomain(DomainStart=panel, DomainEnd=multiplication)

# ---- group: The number to control resolution
panel_2 = Panel("8000")

# ----
rectangle = Rectangle(Plane=PlaneXY(0, 0, 0), XSize=dom, YSize=dom, Radius=0)  # -> Rectangle, Length
pop2d = Populate2D(Region=rectangle.Rectangle, Count=panel_2, Seed=1)
del = DelaunayMesh(Points=pop2d, Plane=PlaneXY(0, 0, 0))

# ---- group: Central holes/ the area not to contract
srf = Surface([<surface referenced from the Rhino model> x7])

# ---- group: Big portal single rings/ the area not to contract
srf_2 = Surface([<surface referenced from the Rhino model> x24])

# ---- group: Portal double rings/ the area to contract
srf_3 = Surface([<surface referenced from the Rhino model> x24])

# ----
medges = MeshEdges(Mesh=del)  # -> NakedEdges, InteriorEdges, NonManifoldEdges
crv = Curve(graft(medges.InteriorEdges))
crv_2 = Curve(medges.NakedEdges)
end = EndPoints(Curve=crv_2)  # -> Start, End

# ---- group: KEY points to be controlled
end_2 = EndPoints(Curve=crv)  # -> Start, End

# ----
colom = CollisionOneMany(Collider=end_2.End, Obstacles=srf_2)  # -> Collision, Index
colom_2 = CollisionOneMany(Collider=end_2.Start, Obstacles=srf_2)  # -> Collision, Index
colom_3 = CollisionOneMany(Collider=end_2.Start, Obstacles=srf_3)  # -> Collision, Index
colom_4 = CollisionOneMany(Collider=end_2.End, Obstacles=srf_3)  # -> Collision, Index
anchor = Anchor(Point=[end.Start, end.End], Strength=10000)
colom_5 = CollisionOneMany(Collider=end_2.Start, Obstacles=srf)  # -> Collision, Index
colom_6 = CollisionOneMany(Collider=end_2.End, Obstacles=srf)  # -> Collision, Index
not = GateNot(A=colom.Collision)
not_2 = GateNot(A=colom_2.Collision)
or = GateOr(A=colom_5.Collision, B=colom_6.Collision)
or_2 = GateOr(A=not_2, B=not)
cull = CullPattern(List=end_2.Start, CullPattern=colom_3.Collision)
cull_2 = CullPattern(List=end_2.Start, CullPattern=colom_4.Collision)
not_3 = GateNot(A=or)
item = ListItem(List=end_2.Start, Index=cull, Wrap=True)
item_2 = ListItem(List=end_2.End, Index=cull_2, Wrap=True)
and = GateAnd(A=or_2, B=not_3)
ln = Line(StartPoint=item, EndPoint=item_2)  # -> flatten(Line)
cull_3 = CullPattern(List=end_2.Start, CullPattern=and)
cull_4 = CullPattern(List=end_2.Start, CullPattern=and)
len = Length(Curve=ln)
item_3 = ListItem(List=end_2.Start, Index=cull_3, Wrap=True)
item_4 = ListItem(List=end_2.End, Index=cull_4, Wrap=True)
multiplication_2 = Multiplication(A=len, B=Slider(0.5, range=0..1))
ln_2 = Line(StartPoint=item_3, EndPoint=item_4)  # -> flatten(Line)
length_line = LengthLine(Line=ln, Length=multiplication_2, Strength=Slider(20, range=0..100))
len_2 = Length(Curve=ln_2)
multiplication_3 = Multiplication(A=len_2, B=Slider(1, range=0..1))
length_line_2 = LengthLine(Line=ln_2, Length=multiplication_3, Strength=Slider(0.5, range=0..1))
solver = Solver(GoalObjects=[anchor, length_line, length_line_2], Reset=Toggle(True), Threshold=1e-15, Tolerance=0.01, On=True)  # -> I, V, O
